% Simulink data dictionary vehDynBusDefs.sldd

numWheels = Simulink.Parameter(4, Unit="one")

BusDrvCmds = Simulink.Bus()
  SteerCmd: double, Min=-1, Max=1, Unit="one"  % Normalized handwheel input (steering column).
  AccelCmd: double, Min=0, Max=1, Unit="one"  % Normalized accelerator input
  DecelCmd: double, Min=0, Max=1, Unit="one"  % Normalized footpedal decelerator or brake input
  GearCmd: int8, Unit="one"  % Gear input (could be PRNDL or manual gear numbers) depending on mode of TransModeCmd
  TransModeCmd: int8, Unit="one"  % Used to spec the mode of operation for the transmission (manual, automatic, sport, econ, etc)
  ClutchCmd: double, Min=0, Max=1, Unit="one"  % Normalized footpedal clutch input
  HndBrkCmd: double, Min=0, Max=1, Unit="one"  % Normalized handbrake / park brake input
  EnblSteerCmd: boolean, Min=0, Max=1, Unit="1"  % Boolean signal used to override driver model steering commands with user specified inputs
  SteerHld: boolean, Min=0, Max=1, Unit="1"  % Boolean signal used to hold the current driver model steering output when true
  SteerZero: boolean, Min=0, Max=1, Unit="1"  % Boolean signal used to override driver model steering commands with zero when value is true
  EnblAccelCmd: boolean, Min=0, Max=1, Unit="1"  % Boolean signal used to override driver model accel commands with user specified inputs
  AccelHld: boolean, Min=0, Max=1, Unit="1"  % Boolean signal used to hold the current driver model accel output when true
  AccelZero: boolean, Min=0, Max=1, Unit="1"  % Boolean signal used to override driver model accel commands with zero when value is true
  EnblDecelCmd: boolean, Min=0, Max=1, Unit="1"  % Boolean signal used to override driver model decel commands with user specified inputs
  DecelHld: boolean, Min=0, Max=1, Unit="1"  % Boolean signal used to hold the current driver model decel output when true
  DecelZero: boolean, Min=0, Max=1, Unit="1"  % Boolean signal used to override driver model decel commands with zero when value is true

BusVehRef = Simulink.Bus()
  LngRef: double, Unit="m/s"  % Longitudinal reference velocity
  LtrRef: double, Unit="m"
  XRef: double, Unit="m"  % X reference pose
  YRef: double, Unit="m"  % Y reference pose
  PhiRef: double, Unit="rad"  % Confirmation needed on coords and angular range / units (yaw angle or phi for angular reference)
  CurvRef: double, Unit="1/m"  % Reference path curvature
  CurvGradRef: double, Unit="one"  % reference curvature gradient (as a function of station)

BusEnv = Simulink.Bus()
  Wind: double[3], Unit="m/s"  % Wind veloicty in the global inertial frame
  Gnd: Bus: BusGnd

BusGnd = Simulink.Bus()
  X: double[4], Unit="m"
  Y: double[4], Unit="m"
  Z: double[4], Unit="m"
  lambda_mux: double[4], Min=0, Unit="one"
  lambda_muy: double[4], Min=0, Unit="one"
  VX: double[4], Unit="m/s"
  VY: double[4], Unit="m/s"
  VZ: double[4], Unit="m/s"
  DCM: double[3 3 4]
  OmegaX: double[4], Unit="rad/s"
  OmegaY: double[4], Unit="rad/s"
  OmegaZ: double[4], Unit="rad/s"
  dZdX: double[4], Unit="one"
  dZdY: double[4], Unit="one"